# Grasshopper definition Tree.gh (Grasshopper 0.9.76)
# plug-ins: Python Interpreter

# ---- group: 0850
rad = Radians(Degrees="50")
Z = UnitZ(Factor="100")
multiplication = Multiplication(A="100", B="0.8")
sin = Sine(Value=rad)
cos = Cosine(Value=rad)
multiplication_2 = Multiplication(A=multiplication, B="0.8")
random = Random(Range="0 To 100", Number=1, Seed="2")
random_2 = Random(Range="0 To 100", Number=1, Seed=random)
random_3 = Random(Range="0 To 100", Number=1, Seed=random_2)
random_4 = Random(Range="0 To 100", Number=1, Seed=random_3)
multiplication_3 = Multiplication(A=multiplication, B=cos)
multiplication_4 = Multiplication(A=multiplication, B=sin)
random_5 = Random(Range="0 To 100", Number=1, Seed=random_3)
Z_2 = UnitZ(Factor=multiplication_4)
multiplication_5 = Multiplication(A=multiplication_2, B=cos)
multiplication_6 = Multiplication(A=multiplication_2, B=sin)
Z_3 = UnitZ(Factor=multiplication_6)
multiplication_7 = Multiplication(A=multiplication_2, B="0.8")
multiplication_8 = Multiplication(A=multiplication_7, B=cos)
multiplication_9 = Multiplication(A=multiplication_7, B=sin)
Z_4 = UnitZ(Factor=multiplication_9)
pt = ConstructPoint(XCoordinate=0, YCoordinate=0, ZCoordinate=0)
move = Move(Geometry=pt, Motion=Z)  # -> Geometry, Transform
move_2 = Move(Geometry=move.Geometry, Motion=Z_2)  # -> Geometry, Transform
cir = Circle(Plane=move_2.Geometry, Radius=multiplication_3)
divide = DivideCurve(Curve=cir, Count="3", Kinks=False)  # -> Points, Tangents, Parameters
pdecon = Deconstruct(Point=divide.Points)  # -> XComponent, YComponent, ZComponent
lng = ListLength(List=pdecon.XComponent)
random_6 = Random(Range="0.95 To 1.15", Number=lng, Seed=random)
multiplication_10 = Multiplication(A=random_6, B=pdecon.XComponent)
multiplication_11 = Multiplication(A=random_6, B=pdecon.ZComponent)
pt_2 = ConstructPoint(XCoordinate=multiplication_10, YCoordinate=pdecon.YComponent, ZCoordinate=multiplication_11)
split = SplitList(List=pt_2, Index="1")  # -> ListA, ListB
split_2 = SplitList(List=split.ListB, Index="1")  # -> ListA, ListB
move_3 = Move(Geometry=split_2.ListA, Motion=Z_3)  # -> Geometry, Transform
move_4 = Move(Geometry=split_2.ListB, Motion=Z_3)  # -> Geometry, Transform
move_5 = Move(Geometry=split.ListA, Motion=Z_3)  # -> Geometry, Transform
cir_2 = Circle(Plane=move_4.Geometry, Radius=multiplication_5)
cir_3 = Circle(Plane=move_5.Geometry, Radius=multiplication_5)
cir_4 = Circle(Plane=move_3.Geometry, Radius=multiplication_5)
divide_2 = DivideCurve(Curve=cir_3, Count="3", Kinks=False)  # -> Points, Tangents, Parameters
divide_3 = DivideCurve(Curve=cir_2, Count="3", Kinks=False)  # -> Points, Tangents, Parameters
divide_4 = DivideCurve(Curve=cir_4, Count="3", Kinks=False)  # -> Points, Tangents, Parameters
pdecon_2 = Deconstruct(Point=divide_2.Points)  # -> XComponent, YComponent, ZComponent
lng_2 = ListLength(List=pdecon_2.XComponent)
pdecon_3 = Deconstruct(Point=divide_4.Points)  # -> XComponent, YComponent, ZComponent
lng_3 = ListLength(List=pdecon_3.XComponent)
pdecon_4 = Deconstruct(Point=divide_3.Points)  # -> XComponent, YComponent, ZComponent
lng_4 = ListLength(List=pdecon_4.XComponent)
random_7 = Random(Range="0.95 To 1.15", Number=lng_2, Seed=random_2)
random_8 = Random(Range="0.95 To 1.15", Number=lng_3, Seed=random_3)
random_9 = Random(Range="0.95 To 1.15", Number=lng_4, Seed=random_4)
multiplication_12 = Multiplication(A=random_8, B=pdecon_4.XComponent)
multiplication_13 = Multiplication(A=random_7, B=pdecon_4.ZComponent)
multiplication_14 = Multiplication(A=random_8, B=pdecon_3.ZComponent)
multiplication_15 = Multiplication(A=random_9, B=pdecon_3.XComponent)
multiplication_16 = Multiplication(A=random_7, B=pdecon_2.XComponent)
multiplication_17 = Multiplication(A=random_9, B=pdecon_2.ZComponent)
pt_3 = ConstructPoint(XCoordinate=multiplication_16, YCoordinate=pdecon_2.YComponent, ZCoordinate=multiplication_17)
move_6 = Move(Geometry=pt_3, Motion=Z_4)  # -> Geometry, Transform
cir_5 = Circle(Plane=move_6.Geometry, Radius=multiplication_8)
pt_4 = ConstructPoint(XCoordinate=multiplication_15, YCoordinate=pdecon_3.YComponent, ZCoordinate=multiplication_14)
move_7 = Move(Geometry=pt_4, Motion=Z_4)  # -> Geometry, Transform
cir_6 = Circle(Plane=move_7.Geometry, Radius=multiplication_8)
pt_5 = ConstructPoint(XCoordinate=multiplication_12, YCoordinate=pdecon_4.YComponent, ZCoordinate=multiplication_13)
move_8 = Move(Geometry=pt_5, Motion=Z_4)  # -> Geometry, Transform
cir_7 = Circle(Plane=move_8.Geometry, Radius=multiplication_8)
divide_5 = DivideCurve(Curve=cir_5, Count="3", Kinks=False)  # -> Points, Tangents, Parameters
divide_6 = DivideCurve(Curve=cir_7, Count="3", Kinks=False)  # -> Points, Tangents, Parameters
divide_7 = DivideCurve(Curve=cir_6, Count="3", Kinks=False)  # -> Points, Tangents, Parameters
pdecon_5 = Deconstruct(Point=divide_5.Points)  # -> XComponent, YComponent, ZComponent
lng_5 = ListLength(List=pdecon_5.XComponent)
pdecon_6 = Deconstruct(Point=divide_7.Points)  # -> XComponent, YComponent, ZComponent
lng_6 = ListLength(List=pdecon_6.XComponent)
pdecon_7 = Deconstruct(Point=divide_6.Points)  # -> XComponent, YComponent, ZComponent
lng_7 = ListLength(List=pdecon_7.XComponent)
random_10 = Random(Range="0.95 To 1.15", Number=lng_5, Seed=random_2)
random_11 = Random(Range="0.95 To 1.15", Number=lng_6, Seed=random_3)
random_12 = Random(Range="0.95 To 1.15", Number=lng_7, Seed=random_4)
multiplication_18 = Multiplication(A=random_11, B=pdecon_6.YComponent)
multiplication_19 = Multiplication(A=random_11, B=pdecon_7.YComponent)
multiplication_20 = Multiplication(A=random_11, B=pdecon_7.XComponent)
multiplication_21 = Multiplication(A=random_11, B=pdecon_6.ZComponent)
multiplication_22 = Multiplication(A=random_10, B=pdecon_7.ZComponent)
multiplication_23 = Multiplication(A=random_12, B=pdecon_6.XComponent)
multiplication_24 = Multiplication(A=random_10, B=pdecon_5.XComponent)
multiplication_25 = Multiplication(A=random_10, B=pdecon_5.YComponent)
multiplication_26 = Multiplication(A=random_12, B=pdecon_5.ZComponent)
pt_6 = ConstructPoint(XCoordinate=multiplication_24, YCoordinate=multiplication_25, ZCoordinate=multiplication_26)
pt_7 = ConstructPoint(XCoordinate=multiplication_23, YCoordinate=multiplication_18, ZCoordinate=multiplication_21)
pt_8 = ConstructPoint(XCoordinate=multiplication_20, YCoordinate=multiplication_19, ZCoordinate=multiplication_22)
ln = Line(StartPoint=pt, EndPoint=move.Geometry)
ln_2 = Line(StartPoint=move.Geometry, EndPoint=pt_2)
ln_3 = Line(StartPoint=split.ListA, EndPoint=pt_3)
ln_4 = Line(StartPoint=split_2.ListA, EndPoint=pt_4)
ln_5 = Line(StartPoint=pt_4, EndPoint=pt_7)
ln_6 = Line(StartPoint=pt_3, EndPoint=pt_6)
ln_7 = Line(StartPoint=pt_5, EndPoint=pt_8)
ln_8 = Line(StartPoint=split_2.ListB, EndPoint=pt_5)

# ----
repcount = Slider(3, range=1..5)

# ---- group: Base Length
panel = Panel("100")

# ----
panel_2 = Panel("decreasing rate")
panel_3 = Panel("Angle")

srf = Surface(reparameterize(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))
python = PythonScript(surf=srf, unum=Slider(20, range=1..20), vnum=Slider(20, range=1..20))  # -> out, panels; inputs surf: Surface, unum: Int32, vnum: Int32
# ---------- python: Python ----------
# This makes surface panels by 3 points on an input surface
# input type: surf - Surface, unum - int, vnum - int
import Rhino.Geometry as rg

panels = []
for i in range(unum):
    for j in range(vnum):
        pt1 = surf.PointAt(i/unum, j/vnum)
        pt2 = surf.PointAt((i+0.9)/unum, (j+0.1)/vnum)
        pt3 = surf.PointAt((i+1.2)/unum, (j+1.0)/vnum)
        pt4 = surf.PointAt((i+0.3)/unum, (j+1)/vnum)
        pt5 = surf.PointAt((i+0.6)/unum, (j+0.3)/vnum)
        n1 = surf.NormalAt(i/unum, j/vnum)
        n2 = surf.NormalAt((i+0.9)/unum, (j+0.1)/vnum)
        n3 = surf.NormalAt((i+1.2)/unum, (j+1.0)/vnum)
        n4 = surf.NormalAt((i+0.3)/unum, (j+1)/vnum)
        n5 = surf.NormalAt((i+0.6)/unum, (j+0.3)/vnum)
        
        pt1 += n1*0.2
        pt2 += n2*0.2
        pt3 += n3*-0.1
        pt4 += n4*1.3
        pt5 += n5*1.5
        
        panel = rg.NurbsSurface.CreateFromCorners(pt2, pt3, pt5)
        panels.append(panel)
        panel = rg.NurbsSurface.CreateFromCorners(pt3, pt4, pt5)
        panels.append(panel)
        panel = rg.NurbsSurface.CreateFromCorners(pt4, pt1, pt5)
        panels.append(panel)
# ---------- end python ----------

# ---- group: Base Point
pt_9 = ConstructPoint(XCoordinate=0, YCoordinate=0, ZCoordinate=0)

# ----
sqgrid = Square(Plane=PlaneXY(0, 0, 0), Size=1, ExtentX=Slider(40, range=0..100), ExtentY=Slider(30, range=0..100))  # -> Cells, Points

# ---- group: Base Point
pt_10 = ConstructPoint(XCoordinate=0, YCoordinate=0, ZCoordinate=0)

# ----
rad_2 = Radians(Degrees="55")
Z_5 = UnitZ(Factor=panel)
rad_3 = Radians(Degrees="55")
python_2 = PythonScript(ptTree=sqgrid.Points)  # -> out, a; inputs ptTree: tree of Point3d
# ---------- python_2: Python ----------
import rhinoscriptsyntax as rs

a=[]
for ptList in ptTree.Branches:
    for pt in ptList:
        circle = rs.AddCircle(pt,0.4)
        a.append(circle)
# ---------- end python_2 ----------

# ---- group: Download
python_3 = PythonScript(ptTree=sqgrid.Points)  # -> out, a; inputs ptTree: tree of Point3d
# ---------- python_3: Python ----------
# this iterates a tree of points and put circles
# input type: ptTree : Point3d (Tree Access)
import rhinoscriptsyntax as rs

a = []
for ptList in ptTree.Branches:
    for pt in ptList:
        circle = rs.AddCircle(pt, 0.4)
        a.append(circle)
# ---------- end python_3 ----------

# ----
Z_6 = UnitZ(Factor="100")
multiplication_27 = Multiplication(A=panel, B="0.85")
python_4 = PythonScript(Point=pt_9, DivCount=Slider(3, range=1..5), RepCount=repcount, Length="100", Angle="55", Rate="0.85")  # -> out, Tree; inputs Point: Point3d, DivCount: Int32, RepCount: Int32, Length: Int32, Angle: Int32
# ---------- python_4: Python ----------
import rhinoscriptsyntax as rs

Tree = []
for i in range(RepCount):
    vec0 = rs.VectorCreate((0,0,Length),(0,0,0))
    id = Point
    pt1 = rs.MoveObject(id,vec0)
    
    Tree.append(pt1)
    #rs.VectorCreate(
    #rs.MoveObject(Point
    #rs.AddLine(Point,
# ---------- end python_4 ----------
sin_2 = Sine(Value=rad_2)
cos_2 = Cosine(Value=rad_2)
multiplication_28 = Multiplication(A="100", B="0.85")
sin_3 = Sine(Value=rad_3)
cos_3 = Cosine(Value=rad_3)
multiplication_29 = Multiplication(A=multiplication_27, B="0.85")
multiplication_30 = Multiplication(A=multiplication_28, B="0.85")
panel_4 = Panel(python_4.Tree)
move_9 = Move(Geometry=pt_9, Motion=Z_6)  # -> Geometry, Transform
panel_5 = Panel(python.panels)
ln_9 = Line(StartPoint=pt_9, EndPoint=move_9.Geometry)
multiplication_31 = Multiplication(A=multiplication_27, Cos=cos_2)
multiplication_32 = Multiplication(A=multiplication_27, Sin=sin_2)
move_10 = Move(Geometry=pt_10, Motion=Z_5)  # -> Geometry, Transform
multiplication_33 = Multiplication(A=multiplication_28, Cos=cos_3)
multiplication_34 = Multiplication(A=multiplication_28, Sin=sin_3)
Z_7 = UnitZ(Factor=multiplication_32)
Z_8 = UnitZ(Factor=multiplication_34)
move_11 = Move(Geometry=move_10.Geometry, Motion=Z_7)  # -> Geometry, Transform
panel_6 = Panel(python_4.out)
cir_8 = Circle(Plane=move_11.Geometry, Radius=multiplication_31)
move_12 = Move(Geometry=move_9.Geometry, Motion=Z_8)  # -> Geometry, Transform
ln_10 = Line(StartPoint=pt_10, EndPoint=move_10.Geometry)
cir_9 = Circle(Plane=move_12.Geometry, Radius=multiplication_33)
divide_8 = DivideCurve(Curve=cir_8, Count="3", Kinks=False)  # -> Points, Tangents, Parameters
divide_9 = DivideCurve(Curve=cir_9, Count=10, Kinks=False)  # -> Points, Tangents, Parameters

# ---- group: Sort
flatten = FlattenTree(Tree=divide_8.Points, Path="{0}")
pdecon_8 = Deconstruct(Point=flatten)  # -> XComponent, YComponent, ZComponent
sort = SortList(Keys=pdecon_8.XComponent, ValuesA=flatten)  # -> Keys, ValuesA

# ----
ln_11 = Line(StartPoint=move_10.Geometry, EndPoint=sort.ValuesA)
end = EndPoints(Curve=ln_11)  # -> Start, End
vec2pt = Vector2Pt(PointA=end.Start, PointB=end.End, Unitize=False)  # -> Vector, Length
multiplication_35 = Multiplication(A=multiplication_29, Sin=sin_2)
multiplication_36 = Multiplication(A=multiplication_29, Cos=cos_2)
unit = UnitVector(Vector=vec2pt.Vector)
multiplication_37 = Multiplication(A=unit, B=multiplication_35)
move_13 = Move(Geometry=sort.ValuesA, Motion=multiplication_37)  # -> Geometry, Transform
pl = PlaneNormal(Origin=move_13.Geometry, ZAxis=unit)
cir_10 = Circle(Plane=pl, Radius=multiplication_36)  # -> graft(Circle)
divide_10 = DivideCurve(Curve=cir_10, Count="3", Kinks=False)  # -> Points, Tangents, Parameters
multiplication_38 = Multiplication(A=multiplication_29, B="0.85")
flip = FlipMatrix(Data=divide_10.Points)
ln_12 = Line(StartPoint=sort.ValuesA, EndPoint=flip)  # -> flatten(Line)
multiplication_39 = Multiplication(A=multiplication_38, Sin=sin_2)
multiplication_40 = Multiplication(A=multiplication_38, Cos=cos_2)

# ---- group: Sort
flatten_2 = FlattenTree(Tree=flip, Path="{0}")
pdecon_9 = Deconstruct(Point=flatten_2)  # -> XComponent, YComponent, ZComponent
sort_2 = SortList(Keys=pdecon_9.XComponent, ValuesA=flatten_2)  # -> Keys, ValuesA

# ----
sort_3 = SortList(Keys=pdecon_9.XComponent, ValuesA=ln_12)  # -> Keys, ValuesA
end_2 = EndPoints(Curve=sort_3.ValuesA)  # -> Start, End
vec2pt_2 = Vector2Pt(PointA=end_2.Start, PointB=end_2.End, Unitize=False)  # -> Vector, Length
unit_2 = UnitVector(Vector=vec2pt_2.Vector)
multiplication_41 = Multiplication(A=multiplication_39, B=unit_2)
move_14 = Move(Geometry=sort_2.ValuesA, Motion=multiplication_41)  # -> Geometry, Transform
pl_2 = PlaneNormal(Origin=move_14.Geometry, ZAxis=vec2pt_2.Vector)  # -> flatten(Plane)
multiplication_42 = Multiplication(A=multiplication_38, B="0.85")
cir_11 = Circle(Plane=pl_2, Radius=multiplication_40)  # -> flatten(Circle)
divide_11 = DivideCurve(Curve=cir_11, Count="3", Kinks=False)  # -> Points, Tangents, Parameters
multiplication_43 = Multiplication(A=multiplication_42, Sin=sin_2)
multiplication_44 = Multiplication(A=multiplication_42, Cos=cos_2)
flip_2 = FlipMatrix(Data=divide_11.Points)

# ---- group: Sort
flatten_3 = FlattenTree(Tree=flip_2, Path="{0}")
pdecon_10 = Deconstruct(Point=flatten_3)  # -> XComponent, YComponent, ZComponent
sort_4 = SortList(Keys=pdecon_10.XComponent, ValuesA=flatten_3)  # -> Keys, ValuesA

# ----
ln_13 = Line(StartPoint=sort_2.ValuesA, EndPoint=flip_2)
flatten_4 = FlattenTree(Tree=ln_13, Path="{0}")
sort_5 = SortList(Keys=pdecon_10.XComponent, ValuesA=flatten_4)  # -> Keys, ValuesA
end_3 = EndPoints(Curve=sort_5.ValuesA)  # -> Start, End
vec2pt_3 = Vector2Pt(PointA=end_3.Start, PointB=end_3.End, Unitize=False)  # -> Vector, Length
unit_3 = UnitVector(Vector=vec2pt_3.Vector)
multiplication_45 = Multiplication(A=multiplication_43, B=unit_3)
move_15 = Move(Geometry=sort_4.ValuesA, Motion=multiplication_45)  # -> Geometry, Transform
pl_3 = PlaneNormal(Origin=move_15.Geometry, ZAxis=vec2pt_3.Vector)  # -> flatten(Plane)
cir_12 = Circle(Plane=pl_3, Radius=multiplication_44)  # -> flatten(Circle)
divide_12 = DivideCurve(Curve=cir_12, Count="3", Kinks=False)  # -> Points, Tangents, Parameters
flip_3 = FlipMatrix(Data=divide_12.Points)
ln_14 = Line(StartPoint=sort_4.ValuesA, EndPoint=flip_3)
crv = Curve(ln_10)
crv_2 = Curve(ln_13)
crv_3 = Curve(ln_11)
crv_4 = Curve(ln_12)
crv_5 = Curve(ln_14)
flatten_5 = FlattenTree(Tree=[crv_2, crv_5], Path="{0}")
merge = Merge(Data1=crv, Data2=crv_3, Data3=crv_4, Data4=flatten_5)
preview = CustomPreview(
    Geometry=merge,
    Shader={ambient=RGB(0, 0, 0), diffuse=RGB(255, 105, 180), emission=RGB(76, 32, 54), shine=0.5, specular=RGB(255, 255, 255), transparency=0})
