# Grasshopper definition TreeHouse.gh (Grasshopper 0.9.76)

# ---- group: Base Length
panel = Panel("100")

# ---- group: Base Point
pt = ConstructPoint(XCoordinate=0, YCoordinate=0, ZCoordinate=0)

# ----
rad = Radians(Degrees=Slider(55, range=55..80))
Z = UnitZ(Factor=panel)
multiplication = Multiplication(A=panel, B="0.85")
sin = Sine(Value=rad)
cos = Cosine(Value=rad)
multiplication_2 = Multiplication(A=multiplication, B="0.85")
multiplication_3 = Multiplication(A=multiplication, Cos=cos)
multiplication_4 = Multiplication(A=multiplication, Sin=sin)
move = Move(Geometry=pt, Motion=Z)  # -> Geometry, Transform
Z_2 = UnitZ(Factor=multiplication_4)
move_2 = Move(Geometry=move.Geometry, Motion=Z_2)  # -> Geometry, Transform
cir = Circle(Plane=move_2.Geometry, Radius=multiplication_3)
ln = Line(StartPoint=pt, EndPoint=move.Geometry)
divide = DivideCurve(Curve=cir, Count="3", Kinks=False)  # -> Points, Tangents, Parameters

# ---- group: Sort
flatten = FlattenTree(Tree=divide.Points, Path="{0}")
pdecon = Deconstruct(Point=flatten)  # -> XComponent, YComponent, ZComponent
sort = SortList(Keys=pdecon.XComponent, ValuesA=flatten)  # -> Keys, ValuesA

# ----
ln_2 = Line(StartPoint=move.Geometry, EndPoint=sort.ValuesA)
end = EndPoints(Curve=ln_2)  # -> Start, End
vec2pt = Vector2Pt(PointA=end.Start, PointB=end.End, Unitize=False)  # -> Vector, Length
multiplication_5 = Multiplication(A=multiplication_2, Sin=sin)
multiplication_6 = Multiplication(A=multiplication_2, Cos=cos)
unit = UnitVector(Vector=vec2pt.Vector)
multiplication_7 = Multiplication(A=unit, B=multiplication_5)
move_3 = Move(Geometry=sort.ValuesA, Motion=multiplication_7)  # -> Geometry, Transform
pl = PlaneNormal(Origin=move_3.Geometry, ZAxis=unit)
cir_2 = Circle(Plane=pl, Radius=multiplication_6)  # -> graft(Circle)
divide_2 = DivideCurve(Curve=cir_2, Count="3", Kinks=False)  # -> Points, Tangents, Parameters
multiplication_8 = Multiplication(A=multiplication_2, B="0.85")
flip = FlipMatrix(Data=divide_2.Points)
ln_3 = Line(StartPoint=sort.ValuesA, EndPoint=flip)  # -> flatten(Line)
multiplication_9 = Multiplication(A=multiplication_8, Sin=sin)
multiplication_10 = Multiplication(A=multiplication_8, Cos=cos)

# ---- group: Sort
flatten_2 = FlattenTree(Tree=flip, Path="{0}")
pdecon_2 = Deconstruct(Point=flatten_2)  # -> XComponent, YComponent, ZComponent
sort_2 = SortList(Keys=pdecon_2.XComponent, ValuesA=flatten_2)  # -> Keys, ValuesA

# ----
sort_3 = SortList(Keys=pdecon_2.XComponent, ValuesA=ln_3)  # -> Keys, ValuesA
end_2 = EndPoints(Curve=sort_3.ValuesA)  # -> Start, End
vec2pt_2 = Vector2Pt(PointA=end_2.Start, PointB=end_2.End, Unitize=False)  # -> Vector, Length
unit_2 = UnitVector(Vector=vec2pt_2.Vector)
multiplication_11 = Multiplication(A=multiplication_9, B=unit_2)
move_4 = Move(Geometry=sort_2.ValuesA, Motion=multiplication_11)  # -> Geometry, Transform
pl_2 = PlaneNormal(Origin=move_4.Geometry, ZAxis=vec2pt_2.Vector)  # -> flatten(Plane)
multiplication_12 = Multiplication(A=multiplication_8, B="0.85")
cir_3 = Circle(Plane=pl_2, Radius=multiplication_10)  # -> flatten(Circle)
divide_3 = DivideCurve(Curve=cir_3, Count="3", Kinks=False)  # -> Points, Tangents, Parameters
multiplication_13 = Multiplication(A=multiplication_12, Sin=sin)
multiplication_14 = Multiplication(A=multiplication_12, Cos=cos)
flip_2 = FlipMatrix(Data=divide_3.Points)

# ---- group: Sort
flatten_3 = FlattenTree(Tree=flip_2, Path="{0}")
pdecon_3 = Deconstruct(Point=flatten_3)  # -> XComponent, YComponent, ZComponent
sort_4 = SortList(Keys=pdecon_3.XComponent, ValuesA=flatten_3)  # -> Keys, ValuesA

# ----
ln_4 = Line(StartPoint=sort_2.ValuesA, EndPoint=flip_2)  # -> flatten(Line)
sort_5 = SortList(Keys=pdecon_3.XComponent, ValuesA=ln_4)  # -> Keys, ValuesA
end_3 = EndPoints(Curve=sort_5.ValuesA)  # -> Start, End
vec2pt_3 = Vector2Pt(PointA=end_3.Start, PointB=end_3.End, Unitize=False)  # -> Vector, Length
unit_3 = UnitVector(Vector=vec2pt_3.Vector)
multiplication_15 = Multiplication(A=multiplication_13, B=unit_3)
move_5 = Move(Geometry=sort_4.ValuesA, Motion=multiplication_15)  # -> Geometry, Transform
pl_3 = PlaneNormal(Origin=move_5.Geometry, ZAxis=vec2pt_3.Vector)  # -> flatten(Plane)
cir_4 = Circle(Plane=pl_3, Radius=multiplication_14)  # -> flatten(Circle)
divide_4 = DivideCurve(Curve=cir_4, Count="3", Kinks=False)  # -> Points, Tangents, Parameters
flip_3 = FlipMatrix(Data=divide_4.Points)
ln_5 = Line(StartPoint=sort_4.ValuesA, EndPoint=flip_3)  # -> flatten(Line)
crv = Curve(ln)
crv_2 = Curve(ln_2)
crv_3 = Curve(ln_4)
crv_4 = Curve(ln_3)
crv_5 = Curve(ln_5)
number_slider = Slider(15, range=0..20)
split = SplitList(List=crv, Index="1")  # -> ListA, ListB
number_slider_2 = Slider(0.7, range=0..1)
split_2 = SplitList(List=crv_4, Index="1")  # -> ListA, ListB
split_3 = SplitList(List=crv_2, Index="1")  # -> ListA, ListB
split_4 = SplitList(List=crv_3, Index="1")  # -> ListA, ListB
split_5 = SplitList(List=crv_5, Index="1")  # -> ListA, ListB
len = Length(Curve=split.ListA)
len_2 = Length(Curve=split_2.ListA)
len_3 = Length(Curve=split_3.ListA)
len_4 = Length(Curve=split_4.ListA)
len_5 = Length(Curve=split_5.ListA)
addition = Addition(A=number_slider, B=number_slider_2)
addition_2 = Addition(A=addition, B=number_slider_2)
addition_3 = Addition(A=addition_2, B=number_slider_2)
addition_4 = Addition(A=addition_3, B=number_slider_2)
integer_division = IntegerDivision(A=len, B=number_slider)
integer_division_2 = IntegerDivision(A=len_2, B=addition_2)
integer_division_3 = IntegerDivision(A=len_3, B=addition)
integer_division_4 = IntegerDivision(A=len_4, B=addition_3)
integer_division_5 = IntegerDivision(A=len_5, B=addition_4)
divide_5 = DivideCurve(Curve=crv, Count=integer_division, Kinks=False)  # -> Points, Tangents, Parameters
divide_6 = DivideCurve(Curve=crv_4, Count=integer_division_2, Kinks=False)  # -> Points, Tangents, Parameters
divide_7 = DivideCurve(Curve=crv_2, Count=integer_division_3, Kinks=False)  # -> Points, Tangents, Parameters
divide_8 = DivideCurve(Curve=crv_3, Count=integer_division_4, Kinks=False)  # -> Points, Tangents, Parameters
divide_9 = DivideCurve(Curve=crv_5, Count=integer_division_5, Kinks=False)  # -> Points, Tangents, Parameters
brep = Brep(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)
split_6 = SplitList(List=divide_8.Points, Index="1")  # -> flatten(ListA), flatten(ListB)
split_7 = SplitList(List=divide_7.Points, Index="1")  # -> flatten(ListA), flatten(ListB)
split_8 = SplitList(List=divide_6.Points, Index="1")  # -> flatten(ListA), flatten(ListB)
bbox = BoundingBox(Content=brep, Plane=PlaneXY(0, 0, 0))  # -> Box, Box_2
split_9 = SplitList(List=divide_9.Points, Index="1")  # -> flatten(ListA), flatten(ListB)
split_10 = SplitList(List=split_6.ListA, Index="1")  # -> ListA, ListB
split_11 = SplitList(List=split_8.ListA, Index="1")  # -> ListA, ListB
split_12 = SplitList(List=split_9.ListA, Index="1")  # -> ListA, ListB
area = Area(Geometry=bbox.Box_2)  # -> Area, Centroid
merge = Merge(Data1=split_10.ListA, Data2=split_6.ListB)  # -> flatten(Result)
merge_2 = Merge(Data1=split_11.ListA, Data2=split_8.ListB)  # -> flatten(Result)
merge_3 = Merge(Data1=split_12.ListA, Data2=split_9.ListB)  # -> flatten(Result)
vec2pt_4 = Vector2Pt(PointA=area.Centroid, PointB=divide_5.Points, Unitize=False)  # -> Vector, Length
vec2pt_5 = Vector2Pt(PointA=area.Centroid, PointB=split_7.ListB, Unitize=False)  # -> Vector, Length
vec2pt_6 = Vector2Pt(PointA=area.Centroid, PointB=merge_2, Unitize=False)  # -> Vector, Length
vec2pt_7 = Vector2Pt(PointA=area.Centroid, PointB=merge, Unitize=False)  # -> Vector, Length
vec2pt_8 = Vector2Pt(PointA=area.Centroid, PointB=merge_3, Unitize=False)  # -> Vector, Length
move_6 = Move(Geometry=brep, Motion=vec2pt_4.Vector)  # -> Geometry, Transform
move_7 = Move(Geometry=brep, Motion=vec2pt_5.Vector)  # -> Geometry, Transform
move_8 = Move(Geometry=brep, Motion=vec2pt_7.Vector)  # -> Geometry, Transform
move_9 = Move(Geometry=brep, Motion=vec2pt_8.Vector)  # -> Geometry, Transform
move_10 = Move(Geometry=brep, Motion=vec2pt_6.Vector)  # -> Geometry, Transform
brep_2 = Brep(move_10.Geometry)
brep_3 = Brep(move_8.Geometry)
brep_4 = Brep(move_6.Geometry)
brep_5 = Brep(move_7.Geometry)
number_slider_3 = Slider(4, range=1..10)
brep_6 = Brep(move_9.Geometry)
lng = ListLength(List=brep_4)
lng_2 = ListLength(List=brep_5)
lng_3 = ListLength(List=brep_2)
bbox_2 = BoundingBox(Content=brep_5, Plane=PlaneXY(0, 0, 0))  # -> Box, Box_2
bbox_3 = BoundingBox(Content=brep_4, Plane=PlaneXY(0, 0, 0))  # -> Box, Box_2
lng_4 = ListLength(List=brep_3)
bbox_4 = BoundingBox(Content=brep_2, Plane=PlaneXY(0, 0, 0))  # -> Box, Box_2
lng_5 = ListLength(List=brep_6)
bbox_5 = BoundingBox(Content=brep_3, Plane=PlaneXY(0, 0, 0))  # -> Box, Box_2
area_2 = Area(Geometry=bbox_2.Box_2)  # -> Area, Centroid
area_3 = Area(Geometry=bbox_3.Box_2)  # -> Area, Centroid
bbox_6 = BoundingBox(Content=brep_6, Plane=PlaneXY(0, 0, 0))  # -> Box, Box_2
area_4 = Area(Geometry=bbox_4.Box_2)  # -> Area, Centroid
random = Random(Range="0 To 1", Number=lng, Seed=number_slider_3)
area_5 = Area(Geometry=bbox_5.Box_2)  # -> Area, Centroid
random_2 = Random(Range="0 To 1", Number=lng_2, Seed=number_slider_3)
random_3 = Random(Range="0 To 1", Number=lng_3, Seed=number_slider_3)
area_6 = Area(Geometry=bbox_6.Box_2)  # -> Area, Centroid
random_4 = Random(Range="0 To 1", Number=lng_4, Seed=number_slider_3)
xy = XYPlane(Origin=area_2.Centroid)
xy_2 = XYPlane(Origin=area_3.Centroid)
random_5 = Random(Range="0 To 1", Number=lng_5, Seed=number_slider_3)
xy_3 = XYPlane(Origin=area_4.Centroid)
pi = Pi(Factor=random)
pi_2 = Pi(Factor=random_2)
pi_3 = Pi(Factor=random_3)
xy_4 = XYPlane(Origin=area_5.Centroid)
pi_4 = Pi(Factor=random_4)
xy_5 = XYPlane(Origin=area_6.Centroid)
pi_5 = Pi(Factor=random_5)
rotate = Rotate(Geometry=brep_4, Angle=pi, Plane=xy_2)  # -> Geometry, Transform
rotate_2 = Rotate(Geometry=brep_5, Angle=pi_2, Plane=xy)  # -> Geometry, Transform
rotate_3 = Rotate(Geometry=brep_2, Angle=pi_3, Plane=xy_3)  # -> Geometry, Transform
rotate_4 = Rotate(Geometry=brep_3, Angle=pi_4, Plane=xy_4)  # -> Geometry, Transform
rotate_5 = Rotate(Geometry=brep_6, Angle=pi_5, Plane=xy_5)  # -> Geometry, Transform
merge_4 = Merge(
    Data1=rotate.Geometry,
    Data2=rotate_2.Geometry,
    Data3=rotate_3.Geometry,
    Data4=rotate_4.Geometry,
    Data5=rotate_5.Geometry)  # -> flatten(Result)
pt_2 = Point(Point(0, 0, 0))
bbox_7 = BoundingBox(Content=merge_4, Plane=PlaneXY(0, 0, 0))  # -> Box, Box_2
area_7 = Area(Geometry=bbox_7.Box)  # -> Area, Centroid
vec2pt_9 = Vector2Pt(PointA=area_7.Centroid, PointB=pt_2, Unitize=False)  # -> Vector, Length
devec = DeconstructVector(Vector=vec2pt_9.Vector)  # -> XComponent, YComponent, ZComponent
vec = VectorXYZ(XComponent=devec.XComponent, YComponent=devec.YComponent, ZComponent=0)  # -> Vector, Length
vlen = VectorLength(Vector=vec.Vector)
gradient = Gradient(LowerLimit=0, UpperLimit=1, stops=[0: RGB(255, 255, 255), 1: RGB(0, 0, 0)])
bnd = Bounds(Numbers=vlen)
remap = RemapNumbers(Value=vlen, Source=bnd, Target=Domain(0, 1))  # -> Mapped, Clipped
gradient_2 = Gradient(LowerLimit=0, UpperLimit=1, Parameter=remap.Mapped, stops=[0: RGBA(255, 255, 255, 163), 0.826: RGBA(80, 96, 255, 189)])
preview = CustomPreview(Geometry=merge_4, Shader=gradient_2)
